# Grasshopper definition Day-3.gh (Grasshopper 1.0.7)

panel = Panel("""1
0
1
1
2""")
panel_2 = Panel("""1
2
0""")
panel_3 = Panel("""0
1
1""")
panel_4 = Panel("""25
25
20""")
panel_5 = Panel("""25
25
25
20""")
panel_6 = Panel("""25
25
20""")
mesh = Mesh([<mesh referenced from the Rhino model> x2])
mesh_2 = Mesh([<mesh referenced from the Rhino model> x3])
mesh_3 = Mesh([<mesh referenced from the Rhino model> x3])
entwine = Entwine(Branch00=mesh, Branch01=mesh_2, Branch02=mesh_3, FlattenInputs=True)
entwine_2 = Entwine(Branch00=panel_6, Branch01=panel_4, Branch02=panel_5, FlattenInputs=True)
entwine_3 = Entwine(Branch00=panel_2, Branch01=panel_3, Branch02=panel, FlattenInputs=True)
panel_7 = Panel(entwine_3)
clean = CleanTree(RemoveNulls=True, RemoveInvalid=True, RemoveEmpty=True, Tree=entwine)
clean_2 = CleanTree(RemoveNulls=True, RemoveInvalid=True, RemoveEmpty=True, Tree=entwine_2)
# Classes
clean_3 = CleanTree(RemoveNulls=True, RemoveInvalid=True, RemoveEmpty=True, Tree=entwine_3)
vec = VectorXYZ(XComponent=0, YComponent=Slider(32, range=0..100), ZComponent=0)  # -> Vector, Length
c_script = CSharpScript(typesinput=clean_3, meshesinput=clean, areainput=clean_2, vector=vec.Vector)  # -> out, A, B; inputs typesinput: tree of Int32, meshesinput: tree of Mesh, areainput: tree of Double, vector: Vector3d
# ---------- c_script: C# ----------
    //////adding data for meshes
    var Apartments = new List<Apartment>();



    for(var i = 0; i < meshesinput.BranchCount;i++)
    {
      var Apartment = new Apartment();
      for(var j = 0; j < meshesinput.Branches[i].Count; j++)
      {
        Apartment.AddSpace(typesinput.Branches[i][j], areainput.Branches[i][j], meshesinput.Branches[i][j]);

      }
      Apartments.Add(Apartment);

    }

    //moving the copied points
    var movedApartments = new List<Apartment>();
    foreach(var item in Apartments)
    {
      movedApartments.Add(Apartment.ApartmentMove(vector, item));

    }

    //outputting the results
    var OutPuttree = new DataTree<Mesh>();
    for (int i = 0 ; i < movedApartments.Count; i++)
    {
      for (int j = 0 ; j < movedApartments[i].GetMeshes().Count; j++)
      {
        OutPuttree.Add(movedApartments[i].GetMeshes()[j], new GH_Path(i));
      }
    }


    //checking the functions for closing the doors and the windows

    var door1 = new Door(2, 0.5);
    door1.Open();
    var win1 = new Window(2, 1);
    win1.Open();
    var win2 = new Window (2, 1);
    var connections = new List<IConnection>();
    connections.Add(door1);
    connections.Add(win1);
    connections.Add(win2);
    door1.Open();
    win1.Open();
    Apartments[0].Each_Apartment[0].addConnection(connections);
    Apartments[0].CloseConnections();
    Print(win1.IsOpen.ToString());
    Print(door1.IsOpen.ToString());

    //  B = temp;
    A = OutPuttree;
# ---------- c_script: C# additional code ----------
  // create a space class that represent each module

  public abstract class Space
  {

    //variables needed for each Apartment
    public int Type { get; set; }
    public double Area { get; set; }
    public Mesh mesh { get; set; }
    public List<IConnection> Connections { get; set; }
    // it shows the user how to create an object of this class
    public Space(int type, double area, Mesh mesh)
    {
      this.Type = type;
      this.Area = area;
      this.mesh = mesh;
      Connections = new List<IConnection>();
    }
    //methods

    public void addConnection(List<IConnection> connections)
    {
      for(int i = 0; i < connections.Count;i++)
      {
        Connections.Add(connections[i]);
      }
    }
    public abstract double calculateResources();



  }
  //create a class apartment

  public class Apartment
  {

    //first we define a parameter that creates a list to store the space objects
    public List<Space> Each_Apartment { get; set; }
    public double price { get; set; }

    // then we initialize the Apartment class
    public Apartment()
    {
      Each_Apartment = new List<Space>();
    }
    ///////////////////////
    /////////////////////
    // this function automatically creates space and add them to the list by getting the values
    public void AddSpace(int type, double area, Mesh mesh)
    {
      switch (type)
      {
        case 1:
          Each_Apartment.Add(new Wetspace(type, area, mesh));
          break;
        case 2:
          Each_Apartment.Add(new livingSpace(type, area, mesh));
          break;
      }
    }

    // we can override this function in case we want to add an existing space
    public void AddSpace(Space sp)
    {
      Each_Apartment.Add(sp);
    }

    // a method to get the meshes
    public List<Mesh> GetMeshes()
    {
      //goes through the spaces and adds the meshes to a list
      var meshes = new List<Mesh>();
      foreach (var space in Each_Apartment)
      {
        meshes.Add(space.mesh);
      }
      return meshes;
    }
    /// <summary>
    ///
    /// </summary>
    /// <returns></returns>

    public List<Point3d> GetAllCenters()
    {
      var CentersAll = new List<Point3d>();

      try
      {
        foreach (var space in Each_Apartment)
        {

          BoundingBox bo = space.mesh.GetBoundingBox(false);
          var Centertemp = bo.Center;
          CentersAll.Add(Centertemp);
        }
      }
      catch (Exception ex)
      {
        RhinoApp.WriteLine(ex.Message);
      }
      return CentersAll;

    }

    /// <summary>
    /// moves a copy of an Apartment with a vector
    /// </summary>
    /// <param name="vec">move vector/param>
    /// <param name="Apartment">the Apartment</param>
    /// <returns></returns>
    public static Apartment ApartmentMove(Vector3d vec, Apartment Apartment)
    {
      if (!vec.IsValid || vec.IsZero)
      {
        throw new ArgumentNullException("vector", "zero or null vector detected");
      }
      var temp = new Apartment();
      try
      {
        for (int k = 0; k < Apartment.GetMeshes().Count; k++)
        {
          var copymesh = Apartment.Each_Apartment[k].mesh.Duplicate();
          bool Move = copymesh.Translate(vec.X, vec.Y, vec.Z);
          //casting should happen for mesh because the output type is geometrybase
          temp.AddSpace(Apartment.Each_Apartment[k].Type, Apartment.Each_Apartment[k].Area, (Mesh) copymesh);

        }

      }
      catch (Exception)
      {
        RhinoApp.WriteLine("problem with ApartmentMove method");
      }

      return temp;

    }
    public void CloseConnections()
    {
      for (int i = 0; i < Each_Apartment.Count; i++)
      {
        for(int j = 0; j < Each_Apartment[i].Connections.Count; j++)
        {
          Each_Apartment[i].Connections[j].Close();
        }
      }
    }
  }

  /////////////////////////////////
  public interface IConnection
  {
    double height { get; set; }
    double width { get; set; }
    Boolean IsOpen { get; set; }

    void Open();
    void Close();
  }
  //////////////////////////////

  public class Door: IConnection
  {
    public double height { get; set; }
    public double width { get; set; }
    public Door(double h, double w)
    {
      this.height = h;
      this.width = w;

    }
    public bool IsOpen { get; set; }

    public void Close()
    {
      IsOpen = false;
    }

    public void Open()
    {
      IsOpen = true;
    }
  }

  ///////////////////////////

  public class livingSpace : Space
  {
    public double Electricityusage { get; set; }
    public double gasusage { get; set; }

    public livingSpace(int type, double area, Mesh mesh) : base(type, area, mesh)
    {
    }

    public override double calculateResources()
    {
      return Electricityusage + gasusage;
    }
  }

  //////////////////////////////
  public class Wetspace : Space
  {
    public double waterusage { get; set; }
    public double Electricityusage { get; set; }

    public Wetspace(int type, double area, Mesh mesh) : base(type, area, mesh)
    {
    }

    public override double calculateResources()
    {
      return  waterusage + Electricityusage;
    }
  }

  /////////////////////////////
  public class Window : IConnection
  {
    public double height { get; set; }
    public double width { get; set; }
    public bool IsOpen { get ; set; }
    public Window(double h, double w)
    {
      this.height = h;
      this.width = w;

    }
    public void Close()
    {
      IsOpen = false;
    }

    public void Open()
    {
      IsOpen = true;
    }
  }
# ---------- end c_script ----------
panel_8 = Panel(c_script.out)
panel_9 = Panel(c_script.B)
mesh_4 = Mesh(c_script.A)
c_script_2 = CSharpScript()  # -> Out, A
panel_10 = Panel(mesh_4)
